# Grasshopper definition BridgeTheGap_Example.ghx (Grasshopper 1.0.7)

fictive_geometry_input = GhPythonScript()  # -> out, geometry
# ---------- fictive_geometry_input: Python ----------
__author__ = "julia"
__version__ = "2021.10.14"

import rhinoscriptsyntax as rs

part1 = [[4.0, 3.2, 1.0], [-1.0, 0.0, 0.0], [0.0, 1.0, 0.0], 6.4]
part2 = [[4.0, 3.2, 1.0], [-1.0, 0.0, 0.0], [0.0, 1.0, 0.0], 4.8]
part3 = [[4.0, 3.2, 1.0], [-1.0, 0.0, 0.0], [0.0, 1.0, 0.0], 7.2]
part4 = [[4.0, 3.2, 1.0], [-1.0, 0.0, 0.0], [0.0, 1.0, 0.0], 3.5]

geometry = [part1, part2, part3, part4]
# ---------- end fictive_geometry_input ----------
aim = GhPythonScript(geometry=fictive_geometry_input.geometry)  # -> out, a; inputs geometry: list
# ---------- aim: Python ----------
from __future__ import absolute_import
from __future__ import print_function

__author__ = "julia"
__version__ = "2021.10.14"

import rhinoscriptsyntax as rs
from compas.geometry import Frame, Point, Vector
import os
import getpass
import sys
username = getpass.getuser()
USER_FOLDER = os.path.abspath(os.path.join("C:/Users/", username))
DATA = os.path.abspath(os.path.join(USER_FOLDER,"workspace/projects/bridgethegap_example/src/bridgethegap_example/assembly"))
if not DATA in sys.path:
    sys.path.append(DATA)

"""
from assembly_bridgeTheGap import BridgeAssembly
from element_bridgeTheGap import BridgeElement

for id, element in enumerate(geometry):
    element_frame = Frame(element[0], element[1], element[2])
    element_profile = geometry[3]
    
    #newBridgeElement = BridgeElement(id, 0, element_frame, element_profile)
    newBridgeElement = BridgeElement(2, 2, element_frame, [0.1, 0.1, 0.1])
"""

from compas.geometry import Point, Frame, Vector
from bridgethegap_example.assembly import BridgeAssembly
from bridgethegap_example.assembly import BridgeElement

myFrame = Frame(Point(0.2, 0.2, 0.2), Vector(-1,0,0), Vector(0,1,0))
myElement = BridgeElement(2, 2, myFrame, [0.1, 0.1, 0.1])
myElement2 = BridgeElement(2, 2, myFrame, [0.1, 0.1, 0.1])
myElements = [myElement, myElement2]

myAssembly = BridgeAssembly(myElements, myFrame, 0.4)
myAssembly.prepare_assembly()
print("hello")
# ---------- end aim ----------
