# Grasshopper definition bridge_the_gap_design_workflow.ghx (Grasshopper 1.0.7)
# plug-ins: CEM_Calculate_Structure, CEM_Extract_Structure, CEM_Extract_Topology, CEM_Load, CEM_Bound_Origin_Node, CEM_Origin_Node, CEM_Optimization_Setup, CEM_Support, Kangaroo2 Components, CEM_Deviation, CEM_Target, CEM_Trail, CEM_Bound_Deviation, karambaGH, CEM_Material_Properties, CEM_Build_Topology, CEM_Bound_Trail

# With this tool we can refresh the connected Python files.
# This way we don't need to restart Rhino for changes to be adopted.
path = PythonScript()  # -> HERE, DATA, ROBOT_DESCRIPTION
# ---------- path: Python ----------
import os

HERE = os.path.dirname(ghdoc.Path)
DATA = os.path.abspath(os.path.join(HERE, "..", "data"))
ROBOT_DESCRIPTION = os.path.abspath(os.path.join(DATA, "robot_description"))

print(HERE)
print(DATA)
print(ROBOT_DESCRIPTION)
# ---------- end path ----------

# ----
# CEM TOPOLOGY DIAGRAM
deviationmagn = Slider(1.77, range=-10..10)
deviationmagn_2 = Slider(1.43, range=-10..10)
deviationmagn_3 = Slider(-7.45, range=-10..10)
loadmagnz = Slider(0, range=-10..10)
loadmagnx = Slider(0, range=-10..10)
loadmagny = Slider(-1, range=-10..10)
traillen = Slider(1, range=-10..10)
deviationedge = Line(flatten(Line((3, 0, 0), (4, 0, 0))))
deviationedge_2 = Line(flatten([Line((1, 1, 0), (1, 0, 0)), Line((2, 1, 0), (2, 0, 0)), Line((3, 1, 0), (3, 0, 0)), Line((4, 1, 0), (4, 0, 0)), Line((5, 1, 0), (5, 0, 0)), Line((6, 1, 0), (6, 0, 0))]))
deviationedge_3 = Line(flatten(Line((3, 1, 0), (4, 1, 0))))
curve = Curve(reparameterize([<curve referenced from the Rhino model> x12]))
pointload = Point([<point referenced from the Rhino model> x6])
support = Point([<point referenced from the Rhino model> x4])
cem_deviation = CEM_Deviation(DeviationEdge=flatten(deviationedge_3), DeviationMagn=flatten(deviationmagn_3))
cem_deviation_2 = CEM_Deviation(DeviationEdge=flatten(deviationedge_2), DeviationMagn=flatten(deviationmagn_2))
cem_load = CEM_Load(PointLoad=flatten(pointload), LoadMagnX=flatten(loadmagnx), LoadMagnY=flatten(loadmagny), LoadMagnZ=flatten(loadmagnz))
cem_deviation_3 = CEM_Deviation(DeviationEdge=flatten(deviationedge), DeviationMagn=flatten(deviationmagn))
cem_trail = CEM_Trail(TrailEdge=flatten(curve), TrailLen=flatten(traillen))
cem_support = CEM_Support(Support=flatten(support))
cem_build_topology = CEM_Build_Topology(T=cem_trail, L=cem_load, D=[cem_deviation, cem_deviation_2, cem_deviation_3], S=cem_support)
cem_extract_topology = CEM_Extract_Topology(TP=cem_build_topology)  # -> Nodes, NodesID, Edges, EdgesID, ConstraintPlane, ConstraintPlaneID, OriginNode, OriginNodeID

# ----
# CEM FORM DIAGRAM
# Creating the basic line geometry using CEM
merge = Merge(Data1=deviationedge_3, Data2=deviationedge, Data3=deviationedge_2)  # -> flatten(Result)
list_length = ListLength(List=flatten(curve))
list_length_2 = ListLength(List=flatten(merge))
panel = Panel("""15
3
7
11""")
series = Series(Start=0, Step=1, Count=list_length)
series_2 = Series(Start=0, Step=1, Count=list_length_2)
boundscoefforiginnode = Slider(0.1, range=0..20)
specific_weight_kn_m3 = Slider(77.5, range=50..300)
yieldstress_kn_m2 = Slider(550000, range=100000..1000000)
number_slider = Slider(0, range=0..100)
targetnodecoeff = Slider(1, range=1..50)
boundlowtrail = Slider(2, range=0..100)
bounduptrail = Slider(5, range=0..100)
boundupdev = Slider(10, range=0..100)
boundlowdev = Slider(3, range=0..211)
self_weight = BooleanToggle(False)
supports = Point([<point referenced from the Rhino model> x4])
originnode = Point([<point referenced from the Rhino model> x4])
cem_origin_node = CEM_Origin_Node(OriginNode=flatten(originnode), OriginNodeID=flatten(cem_extract_topology.OriginNodeID))
cem_target = CEM_Target(TargetNode=flatten(supports), TargetNodeID=flatten(panel), TargetNodeCoeff=flatten(targetnodecoeff))
cem_bound_origin_node = CEM_Bound_Origin_Node(
    BoundOriginNodeID=flatten(cem_extract_topology.OriginNodeID),
    BoundUpOriginNodeX=flatten(boundscoefforiginnode),
    BoundLowOriginNodeX=flatten(boundscoefforiginnode),
    BoundUpOriginNodeY=flatten(boundscoefforiginnode),
    BoundLowOriginNodeY=flatten(boundscoefforiginnode),
    BoundUpOriginNodeZ=flatten(number_slider),
    BoundLowOriginNodeZ=flatten(number_slider))
cem_bound_trail = CEM_Bound_Trail(BoundTrailID=flatten(series), BoundUpTrail=flatten(bounduptrail), BoundLowTrail=flatten(boundlowtrail))
cem_bound_deviation = CEM_Bound_Deviation(BoundDevID=flatten(series_2), BoundUpDev=flatten(boundupdev), BoundLowDev=flatten(boundlowdev))
cem_material_properties = CEM_Material_Properties(SelfWeight=self_weight, YieldStress=yieldstress_kn_m2, SpecWeight=specific_weight_kn_m3)
relativetolerance = Slider(1e-05, range=0..0.1)
gradientdelta = Slider(0.003083, range=0..0.1)
maxiterations = Slider(50, range=1..100)
value_list = ValueList({"LD_AUGLAG", "LD_LBFGS", "LD_SLSQP", "LD_TNEWTON", "LN_BOBYQA", "LN_COBYLA", "LN_SBPLX", "GD_MLSL", "GN_MLSL", "GN_ISRES"}, selected="LD_LBFGS")
cem_optimization_setup = CEM_Optimization_Setup(
    TO=cem_target,
    BO=cem_bound_origin_node,
    BT=cem_bound_trail,
    BD=cem_bound_deviation,
    GradientDelta=gradientdelta,
    RelativeTolerance=relativetolerance,
    MaxIterations=maxiterations,
    OptimAlgorithm=value_list)

panel_2 = Panel("""0
1
-2
-1""")

# ----
# Assembly Information Model provides
# a standardized framework for assembly.
reload = Button()
py = PythonScript(reload=reload)
# ---------- py: Python ----------
from compas_rhino.utilities.misc import get_tolerance
from compas_rhino.utilities.misc import unload_modules

from compas_ghpython import unload_modules
unload_modules("compas")
unload_modules("compas_fab")
unload_modules("roslibpy")
unload_modules("ur_fabrication_control")
unload_modules("assembly_information_model")
unload_modules("bridge_the_gap")
# ---------- end py ----------

# ----
# Before we can start with the actual assembly,
# we must adapt the geometry to it.
# In case of robotic assembly this means
# creating layers, in case of AR assembly
# this means shortening the boards
# to create space for the connectors.
number_slider_2 = Slider(0.09, range=-0.3..0.3)
layering = BooleanToggle(True)
# NODES DESIGN
draw = BooleanToggle(True)

# ----
# The simulation of the robotic assembly with a ur10e robot.
number_slider_3 = Slider(0, range=-2..2)
X = UnitX(Factor=1)
Y = UnitY(Factor=1)
pt = ConstructPoint(XCoordinate=Slider(0.4, range=-2..2), YCoordinate=Slider(0.1, range=-2..2), ZCoordinate=number_slider_3)
rev = Reverse(Vector=X)
pl = ConstructPlane(Origin=pt, XAxis=rev, YAxis=Y)

# ----
# Move Work Piece
number_slider_4 = Slider(-12.3, range=-15..10)
python = GhPythonScript(x=number_slider_4, y=Slider(0.8, range=-10..10), z=Slider(0, range=-10..10))  # -> out, T
# ---------- python: Python ----------
__author__ = "julia"
__version__ = "2021.10.22"

import rhinoscriptsyntax as rs
from compas.geometry import Translation, Vector

T = Translation.from_vector(Vector(x,y,z))
# ---------- end python ----------

scale = Slider(3, range=0..8)

# ----
# FORM FINDING
number_slider_5 = Slider(0.07, range=0..1)
text_tag_3d = TextTag3D(Location=cem_extract_topology.Nodes, Text=cem_extract_topology.NodesID, Size=number_slider_5, Justification=7)
text_tag_3d_2 = TextTag3D(Location=cem_extract_topology.Edges, Text=cem_extract_topology.EdgesID, Size=number_slider_5, Justification=7)

# ----
# CEM CALCULATION
cem_calculate_structure = CEM_Calculate_Structure(TP=cem_build_topology, N=cem_origin_node, SW=cem_material_properties, O=cem_optimization_setup)
cem_extract_structure = CEM_Extract_Structure(M=cem_calculate_structure)  # -> Nodes, NodesID, Trails, TrailsID, TrailsCol, TrailsMag, Deviations, DeviationsID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
custom_preview = CustomPreview(
    Geometry=[cem_extract_structure.Trails, cem_extract_structure.Deviations],
    Material=[cem_extract_structure.TrailsCol, cem_extract_structure.DeviationsCol])
text_tag_3d_3 = TextTag3D(Location=cem_extract_structure.Nodes, Text=cem_extract_structure.NodesID, Size=number_slider_5, Justification=7)

form_found_wireframe_geometry = Line([cem_extract_structure.Trails, cem_extract_structure.Deviations])

# ----
# Finalizing the Wireframe Geometry
explode = Explode(Curve=form_found_wireframe_geometry, Recursive=True)  # -> flatten(Segments), flatten(Vertices)
removeduplicatepts = RemoveDuplicatePts(Points=explode.Vertices, Tolerance=0.01)
point = Point(<point referenced from the Rhino model>)
circle = Circle(Plane=point, Radius=1)
sort_along_curve = SortAlongCurve(Points=removeduplicatepts, Curve=circle)  # -> Points, Indices
# Creating some additional diagonals
# that couldn't be created in CEM
all_points = Point(removeduplicatepts)
shift_list = ShiftList(List=sort_along_curve.Points, Shift=-1, Wrap=True)
split_list = SplitList(List=shift_list, Index=8)  # -> ListA, ListB
lower_cord = SplitList(List=split_list.ListB, Index=4)  # -> ListA, ListB
upper_cord = SplitList(List=split_list.ListA, Index=4)  # -> ListA, ListB
reverse_list = ReverseList(List=upper_cord.ListB)
cull_index = CullIndex(List=lower_cord.ListA, Indices=-1, Wrap=True)
reverse_list_2 = ReverseList(List=lower_cord.ListB)
cull_index_2 = CullIndex(List=reverse_list, Indices=-1, Wrap=True)
cull_index_3 = CullIndex(List=reverse_list_2, Indices=-1, Wrap=True)
reverse_list_3 = ReverseList(List=cull_index)
shift_list_2 = ShiftList(List=reverse_list_3, Shift=1, Wrap=True)
cull_index_4 = CullIndex(List=upper_cord.ListA, Indices=-1, Wrap=True)
reverse_list_4 = ReverseList(List=cull_index_3)
shift_list_3 = ShiftList(List=reverse_list_4, Shift=1, Wrap=True)
diagonalsleft = Line(StartPoint=cull_index_2, EndPoint=shift_list_2)
diagonalsright = Line(StartPoint=cull_index_4, EndPoint=shift_list_3)

deconstruct = Deconstruct(Point=all_points)  # -> XComponent, YComponent, ZComponent
sort_list = SortList(Keys=deconstruct.XComponent, ValuesValuesA=all_points)  # -> Keys, ValuesValuesA
list_item = ListItem(List=sort_list.ValuesValuesA, Index=panel_2, Wrap=True)

split_list_2 = SplitList(List=list_item, Index="2")  # -> ListA, ListB
split_list_3 = SplitList(List=split_list_2.ListA, Index="1")  # -> ListA, ListB
split_list_4 = SplitList(List=split_list_2.ListB, Index="1")  # -> ListA, ListB
end_diagonal_right = Line(StartPoint=split_list_4.ListA, EndPoint=split_list_4.ListB)
end_diagonal_left = Line(StartPoint=split_list_3.ListA, EndPoint=split_list_3.ListB)

end_diagonals = Line([end_diagonal_left, end_diagonal_right])
diagonals_added = Line([diagonalsright, diagonalsleft])

# ----
# SORTING
# For subsequent operations,
# we must categorize the lines
# in diagonals/upper cord/lower cord
# and end pieces
line_sorting = GhPythonScript(
    cords=cem_extract_structure.Trails,
    diagonals_mostly=cem_extract_structure.Deviations,
    diagonals_added=diagonals_added,
    end_diagonals=end_diagonals)  # -> out, lines_dict; inputs cords: list of Line, diagonals_mostly: list of Line, diagonals_added: list of Line, end_diagonals: list of Line
# ---------- line_sorting: Python ----------
import Rhino.Geometry as rg

# returns the x-Value of the line's center point
def check_x(elem):
    return rg.Line.PointAt(elem, 0.5)[0]

def append_lines(base_list, line_list, key):
    for i, line in enumerate(line_list):
        base_list.append({"geometry":line,"category": key, "index_in_category": i})
    return base_list


upper_cords = []
lower_cords = []
diagonals = []

# operations to separate the lines into categories
for i, line in enumerate(cords):
    remainder = i%4
    if remainder == 0 or remainder == 1:
        upper_cords.append(line)
    else:
        lower_cords.append(line)

for i, line in enumerate(diagonals_mostly):
    if i == 0:
        upper_cords.append(line)
    elif i == len(diagonals_mostly)-1:
        lower_cords.append(line)
    else:
        diagonals.append(line)

for line in diagonals_added:
    diagonals.append(line)


upper_cords.sort(key=check_x)
lower_cords.sort(key=check_x)
diagonals.sort(key=check_x)
end_diagonals.sort(key=check_x)


lines_dict = []
lines_dict = append_lines(lines_dict, upper_cords, "upper_cords")
lines_dict = append_lines(lines_dict, lower_cords, "lower_cords")
lines_dict = append_lines(lines_dict, diagonals, "diagonals")
lines_dict = append_lines(lines_dict, end_diagonals, "end_diagonals")
# ---------- end line_sorting ----------

# ----
# ASSEMBLY INFORMATION MODEL
lines_to_aim = GhPythonScript(lines_dict=line_sorting.lines_dict)  # -> out, my_bridge, network_lines_output; inputs lines_dict: list
# ---------- lines_to_aim: Python ----------
import rhinoscriptsyntax as rs
import Rhino.Geometry as rg
import sys

from compas.geometry import Vector, Point, Line, Frame
from bridge_the_gap.assembly import BridgeAssembly, BridgeElement
from compas_ghpython.artists import LineArtist

def transfer_point_rg_to_compas(rg_point):    
    compas_point = Point(rg_point[0], rg_point[1])
    return compas_point

def line_to_frame(input_line):
    # get the dimensions and locations of the boards
    board_length = input_line.Length
    center_point = transfer_point_rg_to_compas(rg.Line.PointAt(input_line, 0.5))    
    # next up is defining the exact orientation of the individual boards
    left_point = transfer_point_rg_to_compas(rg.Line.PointAt(input_line, 0))    
    right_point = transfer_point_rg_to_compas(rg.Line.PointAt(input_line, 1))    
    vector_x = Vector.from_start_end(right_point, left_point)
    # this is optional but recommendable in order to ensure a contant orientation
    # this will become important in the assembly later
    if vector_x[0] < 0:
        vector_x.invert()
    vector_x.unitize()    
    vector_z = [0,0,1]
    vector_y = vector_x.cross(vector_z)    
    return Frame(center_point, vector_x, vector_y)


my_bridge = BridgeAssembly()
for input_line in lines_dict:
    myline = input_line["geometry"]
    line_category = input_line["category"]
    line_category_index = input_line["index_in_category"]
    board_center_frame = line_to_frame(myline)
    board_start_point = transfer_point_rg_to_compas(rg.Line.PointAt(myline, 0))
    board_end_point = transfer_point_rg_to_compas(rg.Line.PointAt(myline, 1))
    board_line = Line(board_start_point, board_end_point)
    myElement = BridgeElement(board_center_frame, Board_Length=myline.Length,
    Category = line_category, Index_In_Category = line_category_index,
    Line=board_line, Endpoints=[board_start_point, board_end_point])
    my_bridge.add_element(myElement)


my_bridge.create_network()
network_lines = my_bridge.visualize_network()
my_artist = LineArtist
network_lines_output =  []
for line in network_lines:
    print(line.start, line.end)
    network_lines_output.append(LineArtist(line).draw())
# ---------- end lines_to_aim ----------

panel_3 = Panel(lines_to_aim.out)
networklines = Line(lines_to_aim.network_lines_output)

# ----
# STRUCTURAL ANALYSIS
# Info
aim_data_for_karamba = GhPythonScript(myBridge=lines_to_aim.my_bridge)  # -> out, all_lines, upper_cord_lines, lower_cord_lines, diagonal_lines
# ---------- aim_data_for_karamba: Python ----------
import rhinoscriptsyntax as rs
import Rhino.Geometry as rg
import sys

from compas.geometry import Vector, Point, Line, Frame
from bridge_the_gap.assembly import BridgeAssembly, BridgeElement

def point_compas_to_rhino(pt):
    return rg.Point3d(pt[0], pt[1], pt[2])

def line_compas_to_rhino(pts):
    return rg.Line(point_compas_to_rhino(pts[0]), point_compas_to_rhino(pts[1]))

all_lines = []
upper_cord_lines = []
lower_cord_lines = []
diagonal_lines = []


for _k, element in myBridge.elements(data=False):
    element_line = line_compas_to_rhino(element.center_line)
    all_lines.append(element_line)
    if element.category == "upper_cords":
        upper_cord_lines.append(element_line)
    elif element.category == "lower_cords":
        lower_cord_lines.append(element_line)
    elif element.category == "diagonals" or element.category == "end_diagonals":
        diagonal_lines.append(element_line)
    else:
        print("Warning: Invalid Category")
        print(element.category)
        print()
# ---------- end aim_data_for_karamba ----------
panel_4 = Panel("""12
13
14
15""")
end = EndPoints(Curve=aim_data_for_karamba.all_lines)  # -> Start, End
end_2 = EndPoints(Curve=aim_data_for_karamba.lower_cord_lines)  # -> Start, End
all_lines = Line(aim_data_for_karamba.all_lines)
all_points_2 = RemoveDuplicatePts(Points=flatten([end.Start, end.End]), Tolerance=0.01)
lower_cord_points = RemoveDuplicatePts(Points=flatten([end_2.Start, end_2.End]), Tolerance=0.01)
all_points_3 = Point(all_points_2)
cull_i = CullIndex(List=all_points_3, Indices=panel_4, Wrap=True)
item = ListItem(List=all_points_3, Index=panel_4, Wrap=True)
supportpoints = Point(item)
spanpoints = Point(cull_i)
material_selection_karamba3d = MaterialSelectionKaramba3D(menu=[dropdown(4), dropdown(1)])
supp = SupportKaramba3D(PosInd=spanpoints, menu=[buttons(off, off, on, off, off, off)])
crossection_dimension = Slider(7, range=5..15)
line_to_beam_karamba3d = LineToBeamKaramba3D(Line=flatten(all_lines), New=True, Remove=True, LimitDistance_m=0.005, Bending=Toggle(False))  # -> Element, Points, Info
unit_y = UnitY(Factor="-10")
support_karamba3d = SupportKaramba3D(PosInd=supportpoints, menu=[buttons(on, on, on, on, on, on)])  # -> flatten(Support)
cross_section_karamba3d = CrossSectionKaramba3D(
    FamilyNameOfCrossSection="DefaultCroSec",
    Material=material_selection_karamba3d,
    Height_cm=crossection_dimension,
    UpperFlangeWidth_cm=crossection_dimension,
    LowerFlangeWidth_cm=crossection_dimension,
    mode="Trapezoid")
loads_karamba3d = LoadsKaramba3D(ForceVector=unit_y, Local=False, PosInd=lower_cord_points, LCase=0, mode="Point")
assemble_model_karamba3d = AssembleModelKaramba3D(
    Elem=line_to_beam_karamba3d.Element,
    Support=flatten([support_karamba3d, supp]),
    Load=loads_karamba3d,
    CrossSection=cross_section_karamba3d,
    LimitDistance_m=0.005)  # -> Model, Info, Mass_kg, CenterOfGravity
l_300 = Panel("1.67")
analyze_karamba3d = AnalyzeKaramba3D(Model=assemble_model_karamba3d.Model)  # -> CalculatedModel, flatten(MaximumDisplacement_cm), ResultingForceOfGravity_kN, ElasticEnergy_kNm
max_displacement = Panel(analyze_karamba3d.MaximumDisplacement_cm)
division = Division(A=max_displacement, B=l_300)
panel_5 = Panel(division)
model_view_karamba3d = ModelViewKaramba3D(Model=analyze_karamba3d.CalculatedModel, ResultFactors=1, ResultCase=-1)  # -> Model, DeformedMesh, DeformedAxes, DeformedModel
beam_view_karamba3d = BeamViewKaramba3D(Model=model_view_karamba3d.Model)  # -> Model, MeshesOfRenderedBeams, DeformedBeamAxes, LegendColors, LegendTags
beam_forces_karamba3d = BeamForcesKaramba3D(AnalyzedModel=beam_view_karamba3d.Model, LCase=-1, MaximumDistanceBetweenResults_m=-1, NumberOfResultsPerBeamElement=1)  # -> AnalyzedModel, NormalForce_kN, ShearForceVz_kN, ShearForceVy_kN, BendingMomentMt_kNm, BendingMomentMy_kNm, BendingMomentMz_kNm
legend = Legend(Colour=beam_view_karamba3d.LegendColors, Tags=beam_view_karamba3d.LegendTags, LegendType=1)

# ----
# With Karamba we simulate the
# structural behaviour and move on
# from wireframe to solid geometry.
item_2 = ListItem(List=all_points_3, Index=Slider(15, range=0..28), Wrap=True)
by_100 = Division(A=crossection_dimension, B=100)

# ----
# GEOMETRY DESIGN
creeateassemblygeometry = GhPythonScript(
    my_bridge=lines_to_aim.my_bridge,
    board_width=by_100,
    board_height=by_100,
    layering=layering,
    board_extension=number_slider_2)  # -> out, my_bridge
# ---------- creeateassemblygeometry: Python ----------
import rhinoscriptsyntax as rs
from compas.geometry import Translation, Vector

def create_translation(factor):
    return Translation.from_vector(Vector(0,0,board_height*factor))

def execute_transformation(element, transformations):
    if element.index_in_category %2 == 0:
        element.transform(transformations[0])
    else:
        element.transform(transformations[1])
    return element

cords = ["upper_cords", "lower_cords"]
# other categories: diagonals, end_diagonals

# now define the different translations that send the boards up or down
half_up = create_translation(0.5)
half_down = create_translation(-0.5)
one_and_a_half_up = create_translation(1.5)
one_and_a_half_down = create_translation(-1.5)
network_lines = my_bridge.visualize_network()

for _k, element in my_bridge.elements(data=False):
    element.width = board_width
    element.height = board_height
    element.frame[0][2] = 0
    element.length = element.node_to_node_length    
    element.length += board_extension
    if not layering:
        continue
    if element.category in cords:
        element = execute_transformation(element, [half_up, half_down])
    elif element.category == "diagonals":
        element = execute_transformation(element, [one_and_a_half_up, one_and_a_half_down])
    elif element.category == "end_diagonals":
        element = execute_transformation(element, [half_down, half_down])
    else:
        print("Warning: Element with invalid category")
        print(element.category)
    print(element.length)
# ---------- end creeateassemblygeometry ----------
daw = GhPythonScript(my_bridge=creeateassemblygeometry.my_bridge, enabled=draw)  # -> out, geometry
# ---------- daw: Python ----------
import rhinoscriptsyntax as rs
import compas
from compas.datastructures import Mesh
from compas_ghpython.artists import MeshArtist

if enabled:
    geometry = []
    
    for _k, element in my_bridge.elements(data=False):
        element = my_bridge.create_object_meshes(element)    
        my_mesh = MeshArtist(element.mesh).draw()
        geometry.append(my_mesh)
# ---------- end daw ----------
meshes = Geometry(daw.geometry)
preview = CustomPreview(Geometry=meshes, Shader=ColourSwatch(SwatchColor=RGB(105, 105, 105)))  # disabled

# ----
# Pickup Plane Reference Point (bottom right)
number_slider_6 = Slider(0.05, range=0..0.5)
division_2 = Division(A=1, B=scale)
define_robotic_assembly = GhPythonScript(
    my_bridge=creeateassemblygeometry.my_bridge,
    safe_plane_distance=number_slider_6,
    pick_plane_reference=pl,
    workpiece_translation=python.T,
    model_scale=division_2)  # -> out, my_bridge_transformed
# ---------- define_robotic_assembly: Python ----------
from __future__ import absolute_import
from __future__ import print_function

import rhinoscriptsyntax as rs
import sys
from compas.geometry import Frame, Point, Vector
from compas.geometry import Translation
from bridge_the_gap.assembly import BridgeAssembly,BridgeElement
import copy



pick_frame_reference = Frame(pick_plane_reference.Origin, pick_plane_reference.XAxis,
    pick_plane_reference.YAxis)
my_bridge.create_assembly_sequence()
my_bridge_transformed = copy.deepcopy(my_bridge)
my_bridge_transformed.transform(workpiece_translation)
my_bridge_transformed.scale_assembly(model_scale)
my_bridge_transformed.prepare_robot_assembly(safe_plane_distance, pick_frame_reference)
# ---------- end define_robotic_assembly ----------

# ----
# ROBOTIC ASSEMBLY
# Robot Model
# Setup and Positioning
list = ValueList({"ur_description", "ur_e_description", "ur_setups"}, selected="ur_e_description")
list_2 = ValueList({"ur3.urdf", "ur3_rot.urdf", "ur5.urdf", "ur10.urdf", "ur3e.urdf", "ur5e.urdf", "ur10e.urdf", "ur10e_rot.urdf"}, selected="ur10e_rot.urdf")
py_2 = PythonScript()  # -> DATA
# ---------- py_2: Python ----------
import os
import getpass

username = getpass.getuser()
USER_FOLDER = os.path.abspath(os.path.join("C:/Users/", username))
DATA = os.path.abspath(os.path.join(USER_FOLDER,"workspace/projects/ur_fabrication_control/data"))

print(USER_FOLDER)
print(DATA)
# ---------- end py_2 ----------
list_3 = ValueList({"ur3.srdf", "ur5.srdf", "ur10.srdf", "ur3e.srdf", "ur5e.srdf", "ur10e.srdf"}, selected="ur10e.srdf")
panel_6 = Panel(py_2)
py_3 = PythonScript(data_path=py_2, package=list, urdf_name=list_2, srdf_name=list_3)  # -> loaders, urdf_filename, srdf_filename
# ---------- py_3: Python ----------
import os
from compas.robots import LocalPackageMeshLoader

path = os.path.join(data_path, "robot_description")

#loaders
packages = ["ur_description", "ur_e_description", "ur_end_effectors", "ur_setups"]
loaders = [LocalPackageMeshLoader(path, pck) for pck in packages]

#files
package_path = os.path.join(path, package)
print package_path

urdf_filename = os.path.join(package_path, "urdf", urdf_name)
srdf_filename = os.path.join(package_path, srdf_name)

assert os.path.isfile(urdf_filename)
assert os.path.isfile(srdf_filename)
# ---------- end py_3 ----------
units = ValueList({"m": 1, "cm": 100, "mm": 1000}, selected="m")
load = Button()
create = PythonScript(load=load, loaders=py_3.loaders, urdf_filename=py_3.urdf_filename, srdf_filename=py_3.srdf_filename, scale_factor=units)  # -> out, robot; inputs load: Boolean, loaders: list
# ---------- create: Python ----------
import os
from scriptcontext import sticky as st

import compas

from compas.robots import RobotModel
from compas.robots import LocalPackageMeshLoader

from compas_fab.robots import Robot
from compas_fab.robots import RobotSemantics

from compas_fab.ghpython import RobotArtist

compas.PRECISION = '12f'

# store robot in component
guid = str(ghenv.Component.InstanceGuid)
robot_key = "robot_" + guid

if robot_key not in st:
    st[robot_key] = None

print loaders
if load:
    model = RobotModel.from_urdf_file(urdf_filename)
    
    model.load_geometry(*loaders)
    artist = RobotArtist(model)
    semantics = RobotSemantics.from_srdf_file(srdf_filename, model)
    robot = Robot(model, artist, semantics, client=None)

    
    st[robot_key] = robot

robot = st[robot_key]


if robot:
    robot.scale(scale_factor)
# ---------- end create ----------
robot = Data(create.robot)
info = PythonScript(robot=robot)  # -> out, main_group_name
# ---------- info: Python ----------
if robot:
    robot.info()
    main_group_name = robot.main_group_name
# ---------- end info ----------
panel_7 = Panel(info.out)
assembly_step = GhPythonScript(
    my_bridge_transformed=define_robotic_assembly.my_bridge_transformed,
    board_id=Slider(12, range=0..27),
    step=Slider(1, range=0..5))  # -> out, plane_WCS, drop_meshes, pick_meshes, attached_collision_meshes; inputs board_id: Int32, step: Int32
# ---------- assembly_step: Python ----------
import rhinoscriptsyntax as rs
import Rhino.Geometry as rg

drop_meshes = []
pick_meshes = []


print(my_bridge_transformed.assembly_sequence)
for i in range(board_id+1):
    element_id = my_bridge_transformed.assembly_sequence[i]
    element = my_bridge_transformed.network.node[element_id]["element"]
    if i < board_id:
        drop_meshes.append(element.mesh)
        continue
    if i == board_id:
        # create the plane for the robotic path planning
        plane = element.path[step]
        plane_WCS = rg.Plane(rg.Point3d(plane[0][0],plane[0][1],plane[0][2]),
            xDirection= rg.Vector3d(plane[1][0],plane[1][1],plane[1][2]),
            yDirection= rg.Vector3d(plane[2][0],plane[2][1],plane[2][2]))
        # define the meshes that are to be visualized
        pick_meshes.append(element.pick_mesh)
        drop_meshes.append(element.mesh)
        break


"""
for _k, element in my_bridge_transformed.elements(data=False):
    if _k < board_id:
        drop_meshes.append(element.mesh)
    if _k == board_id:
        # create the plane for the robotic path planning
        plane = element.path[step]
        plane_WCS = rg.Plane(rg.Point3d(plane[0][0],plane[0][1],plane[0][2]),
            xDirection= rg.Vector3d(plane[1][0],plane[1][1],plane[1][2]),
            yDirection= rg.Vector3d(plane[2][0],plane[2][1],plane[2][2]))
        # define the meshes that are to be visualized
        pick_meshes.append(element.pick_mesh)
        drop_meshes.append(element.mesh)
        break"""
# ---------- end assembly_step ----------
show_drop_mesh = BooleanToggle(True)
show_pick_mesh = BooleanToggle(True)
pln = Plane(assembly_step.plane_WCS)

# ----
# Tool
list_4 = ValueList({"measurement_tool": 0, "air_pick_15mm": 1}, selected="air_pick_15mm")
panel_8 = Panel("Attach a custom tool")
show = BooleanToggle(False)
python_2 = PythonScript(data_path=py_2, tool=list_4, show=show)  # -> tool, M
# ---------- python_2: Python ----------
import os, math
from compas.geometry import Frame, Rotation
from compas.datastructures import Mesh
from compas_ghpython.artists import MeshArtist
from compas_fab.robots import Tool

tolerance = 0

if tool == 0:
    filename = 'measurement_tool_zaxis.stl'
    ee_frame = Frame([0, 0, 0.109], [1, 0, 0], [0, 1, 0])

elif tool == 1:
    filename = 'hrca_airpick_zaxis_withoutacm.stl'
    ee_frame = Frame([0, 0, 0.158 + tolerance], [1, 0, 0], [0, 1, 0])


data_path = os.path.join(data_path, "tool_geometry")
fullfilename = os.path.join(data_path, filename)
print fullfilename

ee_mesh = Mesh.from_stl(fullfilename)

#R = Rotation.from_axis_and_angle(ee_frame.zaxis, math.radians(180), point=ee_frame.point)
#ee_frame.transform(R)

if show:
    artist = MeshArtist(ee_mesh)
    M = artist.draw()

tool = Tool(ee_mesh, ee_frame)
# ---------- end python_2 ----------
py_4 = PythonScript(robot=robot, tool=python_2.tool, attach=Toggle(True))  # -> a
# ---------- py_4: Python ----------
if attach:
    robot.attach_tool(tool)
else:
    robot.detach_tool()
# ---------- end py_4 ----------

# ---- group: forward kinematics
# Configuration
a1 = Slider(0, range=-360..360)
a3 = Slider(90, range=-360..360)
a6 = Slider(90, range=-360..360)
a2 = Slider(-90, range=-360..360)
a5 = Slider(-90, range=-360..360)
a4 = Slider(-90, range=-360..360)
jp = GhPythonScript()  # -> joint_positions
# ---------- jp: Python ----------
import math

joint_positions = [0,-90,90,-90,-90,90]
joint_positions = [math.radians(a) for a in joint_positions]
#joint_positions = [-3.136, -0.328, -1.218, 3.129, 0.852, 0.008]
#joint_positions = [0] * 6



#joint_positions = [1.6239667567485938, 0.25439606475392273, 4.409424838594969-2*3.14, 3.1901607306255908, 1.5707963267948954, 0.053170429953696939]
#joint_positions = [1.598543436748912, 0.23021224965157744, 4.712232135219824-2*3.14, 6.0531299026928744, 4.7123889803846915, 0.027747109954015234]
#joint_positions = [-1.1373533430447322, 4.0117247163121572, 5.4083762087596021-2*3.14, 1.5754733624925168, 4.7123889803846879, 3.5750356373399574]
print joint_positions
# ---------- end jp ----------
forward_kinematics = PythonScript(robot=robot, set_joint_positions=Button(), joint_positions=jp, a1=a1, a2=a2, a3=a3, a4=a4, a5=a5, a6=a6)  # -> full_configuration; inputs joint_positions: list
# ---------- forward_kinematics: Python ----------
import math
import Grasshopper
from compas.robots import Joint
from compas_fab.robots import Configuration

if set_joint_positions:

    j = 0
    for i in range(ghenv.Component.Params.Input.Count):
        nslider = ghenv.Component.Params.Input[i].Sources[0]
        if nslider.GetType() == Grasshopper.Kernel.Special.GH_NumberSlider:
            nslider.TrySetSliderValue(math.degrees(joint_positions[j]))
            j += 1

if robot:
    joint_positions = [a1, a2, a3, a4, a5, a6]
    joint_types = robot.get_configurable_joint_types()
    for i, joint_type in enumerate(joint_types):
        if joint_type == Joint.REVOLUTE:
            joint_positions[i] = math.radians(joint_positions[i])
    full_configuration = Configuration(joint_positions, joint_types)
    
print(full_configuration)
# ---------- end forward_kinematics ----------

# ---- group: inverse kinematics
select_configuration = Slider(0, range=0..7)
inverse = PythonScript(robot=robot, plane_WCS=pln, idx=select_configuration)  # -> out, configuration; inputs plane_WCS: Plane, idx: Int32
# ---------- inverse: Python ----------
import Rhino.Geometry as rg
import math
from compas.geometry import Frame, Transformation, Rotation
from compas_fab.robots import Configuration
from ur_fabrication_control.kinematics.ur_kinematics import inverse_kinematics
from ur_fabrication_control.kinematics.ur_params import ur_params
from compas_ghpython import draw_frame


tcp_WCS = Frame(plane_WCS.Origin, plane_WCS.XAxis, plane_WCS.YAxis)

# transform frame to robot coordinate system
tcp_RCS = robot.to_local_coordinates(tcp_WCS)
tool0_RCS = robot.from_tcf_to_t0cf([tcp_RCS])[0]

# calculate solutions to frame
ur_params = ur_params[robot.name] # get the parameters according to the robot model
solutions = inverse_kinematics(tool0_RCS, ur_params)

if not len(solutions):
    joint_values = [0,0,0,0,0,0]
    configuration = Configuration.from_revolute_values(joint_values)
else:
    joint_values = solutions[idx]
    #print joint_values
    
    ### ***** HACK ***** ##### TODO: CHECK!!!
    for i, v in enumerate(joint_values):
        if v > math.pi:
            v -= 2*math.pi
        if v < -math.pi:
            v += 2*math.pi
        joint_values[i] = v
    ### ***** HACK ***** ##### TODO: CHECK!!!
    
    configuration = [Configuration.from_revolute_values(joint_values)]

print(configuration)
# ---------- end inverse ----------

# ----
list_5 = ValueList({"0 forward_kinematics": 0, "1 inverse_kinematics": 1}, selected="1 inverse_kinematics")
filter = StreamFilter(Gate=list_5, Stream0=forward_kinematics, Stream1=inverse.configuration)

# ----
# Visualisation
show_end_effector_frame = BooleanToggle(True)
show_base_frame = BooleanToggle(False)
show_collision = BooleanToggle(False)
show_frames = BooleanToggle(False)
show_visual = BooleanToggle(True)
show_acm = BooleanToggle(False)
visualize = PythonScript(
    robot=robot,
    group=info.main_group_name,
    configuration=filter,
    redraw=py_4,
    drop_meshes=assembly_step.drop_meshes,
    pick_meshes=assembly_step.pick_meshes,
    show_visual=show_visual,
    show_collision=show_collision,
    show_end_effector_frame=show_end_effector_frame,
    show_frames=show_frames,
    show_base_frame=show_base_frame,
    show_acm=show_acm,
    show_drop_mesh=show_drop_mesh,
    show_pick_mesh=show_pick_mesh)  # -> out, robot, visual, collision, attached_meshes, model_geometry, pick_geometry, frames, ee_frame, base_frame; inputs redraw: list, drop_meshes: list, pick_meshes: list, attached_collision_meshes: list
# ---------- visualize: Python ----------
from compas.geometry import Vector
from compas.geometry import Point
from compas.geometry import Transformation
from compas.geometry import Frame
from compas_ghpython.artists import MeshArtist
from compas_fab.robots import Configuration

print(configuration)

if robot and configuration:
    
    robot.update(configuration, visual=show_visual, collision=show_collision)

    if show_visual:
        visual = robot.artist.draw_visual()

    if show_collision:
        collision = robot.artist.draw_collision()
    
    frames = robot.transformed_frames(configuration, group)

    if show_base_frame:
        base_frame = frames[0]

    if show_end_effector_frame:
        ee_frame = robot.forward_kinematics(configuration, group)
        print("End-effector", ee_frame)
    
    if not show_frames:
        frames = None

    frame = robot.forward_kinematics(configuration, options=dict(solver='model', link_name=robot.attached_tool.link_name))
    robot.artist.update_tool(visual=visual, collision=collision, transformation=Transformation.from_frame_to_frame(Frame.worldXY(), frame))
    
    if show_acm:
        M = []
        for acm in attached_collision_meshes:
            frame = robot.forward_kinematics(configuration, options=dict(solver='model', link_name=acm.link_name))
            T = Transformation.from_frame_to_frame(Frame.worldXY(), frame)
            mesh = acm.collision_mesh.mesh.transformed(T)
            M.append(MeshArtist(mesh).draw())
        attached_meshes = M
    
    if show_drop_mesh:
        model_geometry = []
        for my_mesh in drop_meshes:
            model_geometry.append(MeshArtist(my_mesh).draw())
            
    if show_pick_mesh:
        pick_geometry = []
        if pick_meshes:
            for my_mesh in pick_meshes:
                pick_geometry.append(MeshArtist(my_mesh).draw())
# ---------- end visualize ----------
geo = Geometry(visualize.visual)
draw_2 = GhPythonScript(frames=[visualize.frames, visualize.ee_frame, visualize.base_frame], scale=Slider(0.1, range=0..1))  # -> P, V, C, W; inputs frames: list
# ---------- draw_2: Python ----------
from System.Drawing import Color
from compas_ghpython.utilities import draw_frame

red = Color.FromArgb(255, 0, 0)
green = Color.FromArgb(0, 255, 0)
blue = Color.FromArgb(0, 0, 255)

P = []
V = []
C = []

scale = float(scale)

for frame in frames:
    if not frame:
        continue
    plane = draw_frame(frame)
    P += [plane.Origin] * 3
    V.append(plane.XAxis * scale)
    V.append(plane.YAxis * scale)
    V.append(plane.ZAxis * scale)
    C += [red, green, blue]

W = 3
# ---------- end draw_2 ----------
geo_2 = Geometry([visualize.model_geometry, visualize.pick_geometry])
vdisex = VectorDisplayEx(Point=draw_2.P, Vector=draw_2.V, Colour=draw_2.C, Width=draw_2.W)
preview_2 = CustomPreview(Geometry=geo_2, Shader=ColourSwatch(SwatchColor=RGB(168, 158, 118)))  # disabled
preview_3 = CustomPreview(Geometry=geo, Shader=ColourSwatch(SwatchColor=RGB(105, 105, 105)))  # disabled
